# Dynamo graph GET all DATA8 (2).dyn (Dynamo 2.17.0.3472)
# packages: Arkance Systems 7.4.0, Data-Shapes 2025.3.118, Civil3DToolkit 1.1.32

# group: INPUTS
code_block = CodeBlock { "Cancel"; "تصميم م عمر الخولي"; }
string = StringInput("اختر البيز لاين")
string_2 = StringInput("اختر الكوريدور")
current = Autodesk.AutoCAD.DynamoNodes.Document.Current()
corridors = Corridors(document=current)
code_block_2 = CodeBlock(a=corridors) { a.Name; }
code_block_3 = CodeBlock { 0; }
dropdown_data = Custom[DropDown Data](InputName=string_2, Keys=code_block_2, Values=corridors, DefaultValueIndex=code_block_3)  # package Data-Shapes; Create data for DropDown input in UI.MultiInputForm ++ . Check out www.data-shapes.net for more infos.
boolean = BoolSelector(true)
multipleinputform = Custom[MultipleInputForm ++](Description_optional=code_block.out1, Inputs=dropdown_data, Toggle=boolean, CancelButtonText_optional=code_block.out0)  # package Data-Shapes; Create a form with multiple inputs. see www.data-shapes.net for tutorials and infos!
baselines = Autodesk.Civil.DynamoNodes.Corridor.Baselines(corridor=multipleinputform.User_Inputs)
flatten = List.Flatten(list=baselines)
code_block_4 = CodeBlock(a=flatten) { a.Name; }
code_block_5 = CodeBlock { 0; }
dropdown_data_2 = Custom[DropDown Data](InputName=string, Keys=code_block_4, Values=code_block_4, DefaultValueIndex=code_block_5)
string_3 = StringInput("مسار الاكسيل")
string_4 = StringInput("D:\")
directorypath_data = Custom[DirectoryPath Data](InputName=string_3, DefaultPath=string_4, ButtonText=string_4)  # package Data-Shapes; Creates a DirectoryPath input for UI.MultipleInputForm ++ . Check out www.data-shapes.net for more infos!
string_5 = StringInput("اسم الاكسيل")
code_block_6 = CodeBlock(a=multipleinputform.User_Inputs) { a.Name; }
string_6 = StringInput(".xlsx")
concat = String.Concat(string0=code_block_6, string1=string_6)
concat_2 = String.Concat(string0=concat)
code_block_7 = CodeBlock(a=concat_2) { a[0]; }
textbox_data = Custom[TextBox Data](InputName=string_5, DefaultText=code_block_7)  # package Data-Shapes; Create Data for TextBox input in UI.MultipleInputForm ++ . Check out www.data-shapes.net for more informations
string_7 = StringInput("استخراج الميول التصميمية")
boolean_2 = BoolSelector(false)
code_block_8 = CodeBlock { "تفعيل"; }
boolean_input = Custom[Boolean input](InputName=string_7, DefaultValue=boolean_2, SideText=code_block_8)  # package Data-Shapes; Creates a boolean input for UI.MultipleInputForm ++ . Check out www.data-shapes.net for more infos!
string_8 = StringInput("اوفسيت جميع الاكواد")
boolean_3 = BoolSelector(false)
code_block_9 = CodeBlock { "تفعيل"; }
boolean_input_2 = Custom[Boolean input](InputName=string_8, DefaultValue=boolean_3, SideText=code_block_9)
string_9 = StringInput("توقيع جميع الاكواد")
boolean_4 = BoolSelector(false)
code_block_10 = CodeBlock { "تفعيل"; }
boolean_input_3 = Custom[Boolean input](InputName=string_9, DefaultValue=boolean_4, SideText=code_block_10)
string_10 = StringInput("ماستر شيت")
boolean_5 = BoolSelector(false)
code_block_11 = CodeBlock { "تفعيل"; }
boolean_input_4 = Custom[Boolean input](InputName=string_10, DefaultValue=boolean_5, SideText=code_block_11)
string_11 = StringInput("ميول وعروض بين كودين")
boolean_6 = BoolSelector(false)
code_block_12 = CodeBlock { "تفعيل"; }
boolean_input_5 = Custom[Boolean input](InputName=string_11, DefaultValue=boolean_6, SideText=code_block_12)
string_12 = StringInput("ادخل الانترفل")
code_block_13 = CodeBlock { "20"; }
boolean_7 = BoolSelector(true)
textbox_data_2 = Custom[TextBox Data](InputName=string_12, DefaultText=code_block_13, IsNumberEntry=boolean_7)
list_create = List.Create(item0=dropdown_data_2, item1=directorypath_data, item2=textbox_data, item3=boolean_input, item4=boolean_input_2, item5=boolean_input_3, item6=boolean_input_4, item7=boolean_input_5, item8=textbox_data_2)
flatten_2 = List.Flatten(list=list_create)
not_ = Not(x=multipleinputform.Was_Cancelled)
STOP = And(bool0=not_, bool1=boolean)
code_block_14 = CodeBlock { 200; 600; }
multipleinputform_2 = Custom[MultipleInputForm ++](Description_optional=code_block.out1, Inputs=flatten_2, Toggle=STOP, CancelButtonText_optional=code_block.out0, Width_optional=code_block_14.out1, LabelWidth_optional=code_block_14.out0)
code_block_15 = CodeBlock(b=multipleinputform.User_Inputs, a=multipleinputform_2.User_Inputs) { corridor=b[0]; baselinename=a[0]; excelpath=a[1]; execlname=a[2]; }
code_block_16 = CodeBlock { "\\"; }
concat_3 = String.Concat(string0=code_block_15.excelpath, string1=code_block_16, string2=code_block_15.execlname)
concat_4 = String.Concat(string0=concat_3)
concat_5 = String.Concat(string0=code_block_16, string1=code_block_16)
مسار_الاكسيل_كامل = String.Replace(string=concat_4, searchFor=concat_5, replaceWith=code_block_16)
baselineByName = Autodesk.Civil.DynamoNodes.Corridor.BaselineByName(corridor=code_block_15.corridor, name=code_block_15.baselinename)
alignment = Autodesk.Civil.DynamoNodes.Baseline.Alignment(baseline=baselineByName)
STOP_2 = And(bool0=multipleinputform_2.Was_Cancelled, bool1=multipleinputform.Was_Cancelled, bool2=boolean)
not_2 = Not(x=STOP_2)
code_block_17 = CodeBlock(a=multipleinputform_2.User_Inputs, مسار_الاكسيل_كامل=مسار_الاكسيل_كامل, baseline=baselineByName, alignment=alignment, document=current, not=not_2)
# ---------- code_block_17.designscript (11 lines) ----------
designslopecheck=a[3];
offcetcheck=a[4];
codescheck=a[5];
mastercheck=a[6];
slopewidthcheck=a[7];
مسار_الاكسيل_كامل;
baseline;
alignment;
document;
not;
interval = a[8];
# ----------------------------------------

OFFSET = And(bool0=code_block_17.offcetcheck, bool1=code_block_17.not)
STOP_3 = Python(IN[0]=code_block_17.baseline, IN[1]=OFFSET)  # CPython3
# ---------- STOP_3.python (37 lines) ----------
# Load the Python Standard and DesignScript Libraries
import sys
import clr

# Add Assemblies for AutoCAD and Civil3D
clr.AddReference('AcMgd')
clr.AddReference('AcCoreMgd')
clr.AddReference('AcDbMgd')
clr.AddReference('AecBaseMgd')
clr.AddReference('AecPropDataMgd')
clr.AddReference('AeccDbMgd')

# Import references from AutoCAD
from Autodesk.AutoCAD.Runtime import *
from Autodesk.AutoCAD.ApplicationServices import *
from Autodesk.AutoCAD.EditorInput import *
from Autodesk.AutoCAD.DatabaseServices import *
from Autodesk.AutoCAD.Geometry import *

# Import references from Civil3D
from Autodesk.Civil.ApplicationServices import *
from Autodesk.Civil.DatabaseServices import *

# The inputs to this node will be stored as a list in the IN variables.
dataEnteringNode = IN

adoc = Application.DocumentManager.MdiActiveDocument
editor = adoc.Editor

a=IN[0]
b=IN[1]

if b==False:
    pass
else:
    OUT=a
# Assign your output to the OUT variable.
# ----------------------------------------

# group: OFFSETS
code_block_18 = CodeBlock { 0; }
STOP_4 = Python(IN[0]=code_block_18, IN[1]=OFFSET)  # CPython3; same code as STOP_3
code_block_19 = CodeBlock { "station"; }
corridorFeaturelines = Civil3D.Geometry.Corridor.CorridorFeaturelines(baseline=STOP_3)
stationsAndOffsets = Civil3D.Geometry.CorridorFeatureLine.StationsAndOffsets(corridorFeatureLine=corridorFeaturelines)
code_block_20 = CodeBlock(a=stationsAndOffsets) { a; }
station = Civil3D.Geometry.StationElevation.Station(stationElevation=code_block_20)
offset = Civil3D.Geometry.StationElevation.Offset(stationElevation=code_block_20)
python_script = Python(IN[0]=station, IN[1]=offset)  # CPython3
# ---------- python_script.python (60 lines) ----------
# Load the Python Standard and DesignScript Libraries
import sys
import clr

# Add Assemblies for AutoCAD and Civil3D
clr.AddReference('AcMgd')
clr.AddReference('AcCoreMgd')
clr.AddReference('AcDbMgd')
clr.AddReference('AecBaseMgd')
clr.AddReference('AecPropDataMgd')
clr.AddReference('AeccDbMgd')

# Import references from AutoCAD
from Autodesk.AutoCAD.Runtime import *
from Autodesk.AutoCAD.ApplicationServices import *
from Autodesk.AutoCAD.EditorInput import *
from Autodesk.AutoCAD.DatabaseServices import *
from Autodesk.AutoCAD.Geometry import *

# Import references from Civil3D
from Autodesk.Civil.ApplicationServices import *
from Autodesk.Civil.DatabaseServices import *
#def funs
def flatten(L):
    for item in L:
        try:
            yield from flatten(item)
        except TypeError:
            yield item


# The inputs to this node will be stored as a list in the IN variables.
dataEnteringNode = IN

adoc = Application.DocumentManager.MdiActiveDocument
editor = adoc.Editor
a=[]
b=[]
a=IN[0]
b=IN[1]
k1=[]
k=[]
stations=[]
stations=flatten(a)
stations = sorted(set(stations))

for i1 in range(len(a)):
    a1=a[i1]
    b1=b[i1]
    for i2 in range(len(stations)):
        if stations[i2] in a1:
            i3=a1.index(stations[i2])
            k1.append(b1[i3])
        else:
            k1.append(None)
    k.append(k1)
    k1=[]

# Assign your output to the OUT variable.
OUT = [k,stations]
# ----------------------------------------
code_block_21 = CodeBlock(A=python_script) { A[0]; stations = A[1]; }
addItemToFront = List.AddItemToFront(item=code_block_19, list=code_block_21.stations)
code_block_22 = CodeBlock { "Integer Station"; }
code_block_23 = CodeBlock { 5; }
round = Math.Round(number=code_block_21.stations, digits=code_block_23)
interval = CodeBlock(a=code_block_17.interval) { a; }
integer_station = Python(IN[0]=round, IN[1]=interval)  # CPython3
# ---------- integer_station.python (44 lines) ----------
# Load the Python Standard and DesignScript Libraries
import sys
import clr

# Add Assemblies for AutoCAD and Civil3D
clr.AddReference('AcMgd')
clr.AddReference('AcCoreMgd')
clr.AddReference('AcDbMgd')
clr.AddReference('AecBaseMgd')
clr.AddReference('AecPropDataMgd')
clr.AddReference('AeccDbMgd')

# Import references from AutoCAD
from Autodesk.AutoCAD.Runtime import *
from Autodesk.AutoCAD.ApplicationServices import *
from Autodesk.AutoCAD.EditorInput import *
from Autodesk.AutoCAD.DatabaseServices import *
from Autodesk.AutoCAD.Geometry import *

# Import references from Civil3D
from Autodesk.Civil.ApplicationServices import *
from Autodesk.Civil.DatabaseServices import *

# The inputs to this node will be stored as a list in the IN variables.
dataEnteringNode = IN

adoc = Application.DocumentManager.MdiActiveDocument
editor = adoc.Editor

k1=IN[0]
n1 = IN[1]
k2=[]
for i0 in k1:
    if i0 == None :
        k2.append(None)
    else:
        i=i0//n1
        i1=i*n1
        if i1==i0 :
            k2.append(1)
        else:
            k2.append(0)
# Assign your output to the OUT variable.
OUT = k2
# ----------------------------------------
addItemToFront_2 = List.AddItemToFront(item=code_block_22, list=integer_station)
codeName = Civil3D.Geometry.CorridorFeatureLine.CodeName(corridorFeatureLine=corridorFeaturelines)
python_script_2 = Python(IN[0]=code_block_21.out0, IN[1]=codeName)  # CPython3
# ---------- python_script_2.python (53 lines) ----------
# Load the Python Standard and DesignScript Libraries
import sys
import clr

# Add Assemblies for AutoCAD and Civil3D
clr.AddReference('AcMgd')
clr.AddReference('AcCoreMgd')
clr.AddReference('AcDbMgd')
clr.AddReference('AecBaseMgd')
clr.AddReference('AecPropDataMgd')
clr.AddReference('AeccDbMgd')

# Import references from AutoCAD
from Autodesk.AutoCAD.Runtime import *
from Autodesk.AutoCAD.ApplicationServices import *
from Autodesk.AutoCAD.EditorInput import *
from Autodesk.AutoCAD.DatabaseServices import *
from Autodesk.AutoCAD.Geometry import *

# Import references from Civil3D
from Autodesk.Civil.ApplicationServices import *
from Autodesk.Civil.DatabaseServices import *

# The inputs to this node will be stored as a list in the IN variables.
dataEnteringNode = IN

adoc = Application.DocumentManager.MdiActiveDocument
editor = adoc.Editor
a=[]
b=[]
a=IN[0]
b=IN[1]
a1=len(a)
n=[]
n1=[]
for i in range(len(a)):
    l=b[i]
    n1.append(l)
    for k in a[i]:
        n1.append(k)
    n.append(n1)
    n1=[]








# Assign your output to the OUT variable.

OUT = n
# ----------------------------------------
addItemToFront_3 = List.AddItemToFront(item=addItemToFront_2, list=python_script_2)
addItemToFront_4 = List.AddItemToFront(item=addItemToFront, list=addItemToFront_3)
transpose = List.Transpose(lists=addItemToFront_4)
code_block_24 = CodeBlock { "OFFSET"; }
code_block_25 = CodeBlock(a=STOP_4, b=transpose, c=code_block_17.مسار_الاكسيل_كامل, d=code_block_24, e=OFFSET) { a; b; c; d; e; }
exportToExcel = Data.ExportToExcel(filePath=code_block_25.c, sheetName=code_block_25.d, startRow=code_block_25.a, startColumn=code_block_25.a, data=code_block_25.b, overWrite=code_block_25.e)
code_block_26 = CodeBlock { 2; }  # frozen
round_2 = Math.Round(digits=code_block_26)  # unwired: number

CODS = And(bool0=code_block_17.codescheck, bool1=code_block_17.not)
STOP_5 = Python(IN[0]=code_block_17.baseline, IN[1]=CODS)  # CPython3; same code as STOP_3

# group: siting out
corridorFeatureLines = Autodesk.Civil.DynamoNodes.Baseline.CorridorFeatureLines(baseline=STOP_5)
flatten_3 = List.Flatten(list=corridorFeatureLines)
flatten_4 = List.Flatten(list=flatten_3)
code = Autodesk.Civil.DynamoNodes.CorridorFeatureLine.Code(corridorFeatureLine=flatten_4)
count = List.Count(list=code)

# group: siting out > handling coordinates
points = Autodesk.Civil.DynamoNodes.CorridorFeatureLine.Points(corridorFeatureLine=flatten_3)
X = Point.X(point=points)
flatten_5 = List.Flatten(list=X)
Y = Point.Y(point=points)
flatten_6 = List.Flatten(list=Y)
Z = Point.Z(point=points)
flatten_7 = List.Flatten(list=Z)

# group (continued): siting out
count_2 = List.Count(list=flatten_5)
point_number = CodeBlock(e=count_2) { 1..e..1; }
get_desciption_for_all_points = Python(IN[0]=points, IN[1]=count, IN[2]=code)  # CPython3
# ---------- get_desciption_for_all_points.python (43 lines) ----------
# Load the Python Standard and DesignScript Libraries
import sys
import clr

# Add Assemblies for AutoCAD and Civil3D
clr.AddReference('AcMgd')
clr.AddReference('AcCoreMgd')
clr.AddReference('AcDbMgd')
clr.AddReference('AecBaseMgd')
clr.AddReference('AecPropDataMgd')
clr.AddReference('AeccDbMgd')

# Import references from AutoCAD
from Autodesk.AutoCAD.Runtime import *
from Autodesk.AutoCAD.ApplicationServices import *
from Autodesk.AutoCAD.EditorInput import *
from Autodesk.AutoCAD.DatabaseServices import *
from Autodesk.AutoCAD.Geometry import *

# Import references from Civil3D
from Autodesk.Civil.ApplicationServices import *
from Autodesk.Civil.DatabaseServices import *

# The inputs to this node will be stored as a list in the IN variables.
dataEnteringNode = IN

adoc = Application.DocumentManager.MdiActiveDocument
editor = adoc.Editor


k=[]
a1=IN[0]
a2=IN[1]
a3=IN[2]
for i in range(a2):
    v=a1[i]
    v1=len(v)
    o1=a3[i]
    for i1 in range(v1):
        k.append(o1)
    #k.Append(v1)
# Assign your output to the OUT variable.
OUT = k
# ----------------------------------------
flatten_8 = List.Flatten(list=points)

# group: siting out > get station for the points
flatten_9 = List.Flatten(list=points)
list_create_2 = List.Create(item0=flatten_9)
stationOffsetByPoint = Autodesk.Civil.DynamoNodes.Baseline.StationOffsetByPoint(baseline=STOP_5, point=list_create_2)

# group: siting out > formate station
flatten_10 = List.Flatten(list=stationOffsetByPoint.Station)
code_block_27 = CodeBlock { 2; }
round_3 = Math.Round(number=flatten_10, digits=code_block_27)
convert_number_to_station = Python(IN[0]=round_3)  # CPython3
# ---------- convert_number_to_station.python (39 lines) ----------
# Load the Python Standard and DesignScript Libraries
import sys
import clr

# Add Assemblies for AutoCAD and Civil3D
clr.AddReference('AcMgd')
clr.AddReference('AcCoreMgd')
clr.AddReference('AcDbMgd')
clr.AddReference('AecBaseMgd')
clr.AddReference('AecPropDataMgd')
clr.AddReference('AeccDbMgd')

# Import references from AutoCAD
from Autodesk.AutoCAD.Runtime import *
from Autodesk.AutoCAD.ApplicationServices import *
from Autodesk.AutoCAD.EditorInput import *
from Autodesk.AutoCAD.DatabaseServices import *
from Autodesk.AutoCAD.Geometry import *

# Import references from Civil3D
from Autodesk.Civil.ApplicationServices import *
from Autodesk.Civil.DatabaseServices import *
J=[]
k=[]
i=""
J=IN[0]
for i in J:
    if i == None :
        k.append(None)
    else:
        cadnumk = int(i // 1000)
        cadnumu = i % 1000
        cadtxt=f'{cadnumk}+{cadnumu:06.2f}'
        k.append(cadtxt)
OUT = k
# Commit before end transaction


# Assign your output to the OUT variable.
# ----------------------------------------
code_block_28 = CodeBlock { 5; }
round_4 = Math.Round(number=flatten_10, digits=code_block_28)

# group: siting out > handling offset
flatten_11 = List.Flatten(list=stationOffsetByPoint.Offset)
side_letter = Python(IN[0]=flatten_11)  # CPython3
# ---------- side_letter.python (45 lines) ----------
# Load the Python Standard and DesignScript Libraries
import sys
import clr

# Add Assemblies for AutoCAD and Civil3D
clr.AddReference('AcMgd')
clr.AddReference('AcCoreMgd')
clr.AddReference('AcDbMgd')
clr.AddReference('AecBaseMgd')
clr.AddReference('AecPropDataMgd')
clr.AddReference('AeccDbMgd')

# Import references from AutoCAD
from Autodesk.AutoCAD.Runtime import *
from Autodesk.AutoCAD.ApplicationServices import *
from Autodesk.AutoCAD.EditorInput import *
from Autodesk.AutoCAD.DatabaseServices import *
from Autodesk.AutoCAD.Geometry import *

# Import references from Civil3D
from Autodesk.Civil.ApplicationServices import *
from Autodesk.Civil.DatabaseServices import *

# The inputs to this node will be stored as a list in the IN variables.
dataEnteringNode = IN

adoc = Application.DocumentManager.MdiActiveDocument
editor = adoc.Editor

k1=IN[0]
k2=[]
for i0 in k1:
    if i0 == None :
        k2.append(None)
    else:
        i=round(i0,2)
        if i<0 :
            i1="_L"
        elif i>0 :
            i1="_R"
        else:
            i1="_CL"
        k2.append(i1)
# Assign your output to the OUT variable.
OUT = k2
# ----------------------------------------
SIDE = Python(IN[0]=flatten_11)  # CPython3
# ---------- SIDE.python (45 lines) ----------
# Load the Python Standard and DesignScript Libraries
import sys
import clr

# Add Assemblies for AutoCAD and Civil3D
clr.AddReference('AcMgd')
clr.AddReference('AcCoreMgd')
clr.AddReference('AcDbMgd')
clr.AddReference('AecBaseMgd')
clr.AddReference('AecPropDataMgd')
clr.AddReference('AeccDbMgd')

# Import references from AutoCAD
from Autodesk.AutoCAD.Runtime import *
from Autodesk.AutoCAD.ApplicationServices import *
from Autodesk.AutoCAD.EditorInput import *
from Autodesk.AutoCAD.DatabaseServices import *
from Autodesk.AutoCAD.Geometry import *

# Import references from Civil3D
from Autodesk.Civil.ApplicationServices import *
from Autodesk.Civil.DatabaseServices import *

# The inputs to this node will be stored as a list in the IN variables.
dataEnteringNode = IN

adoc = Application.DocumentManager.MdiActiveDocument
editor = adoc.Editor

k1=IN[0]
k2=[]
for i0 in k1:
    if i0 == None :
        k2.append(None)
    else:
        i=round(i0,2)
        if i<0 :
            i1="LEFT"
        elif i>0 :
            i1="RIGHT"
        else:
            i1="CENTER"
        k2.append(i1)
# Assign your output to the OUT variable.
OUT = k2
# ----------------------------------------

# group (continued): siting out
add_side_to_description = Python(IN[0]=side_letter, IN[1]=get_desciption_for_all_points)  # CPython3
# ---------- add_side_to_description.python (53 lines) ----------
# Load the Python Standard and DesignScript Libraries
import sys
import clr

# Add Assemblies for AutoCAD and Civil3D
clr.AddReference('AcMgd')
clr.AddReference('AcCoreMgd')
clr.AddReference('AcDbMgd')
clr.AddReference('AecBaseMgd')
clr.AddReference('AecPropDataMgd')
clr.AddReference('AeccDbMgd')

# Import references from AutoCAD
from Autodesk.AutoCAD.Runtime import *
from Autodesk.AutoCAD.ApplicationServices import *
from Autodesk.AutoCAD.EditorInput import *
from Autodesk.AutoCAD.DatabaseServices import *
from Autodesk.AutoCAD.Geometry import *

# Import references from Civil3D
from Autodesk.Civil.ApplicationServices import *
from Autodesk.Civil.DatabaseServices import *

# The inputs to this node will be stored as a list in the IN variables.
dataEnteringNode = IN

adoc = Application.DocumentManager.MdiActiveDocument
editor = adoc.Editor
k1=IN[0] #SIDE
k2=IN[1] #Code
h2=[]
i1=len(k1)

for i in range(i1):
    if k2[i] == None or k1[i]== None:
        h2.append(None)
    else:
        h2.append(k2[i]+k1[i])
i2=len(h2)
for i in range(i2):
    if h2[i] == None :
        pass
    else:
        l=h2[i]
        l=l.replace("_R_R","_R")
        l=l.replace("_L_L","_L")
        l=l.replace("_L_CL","_L")
        l=l.replace("_R_CL","_R")
        h2[i]=l


# Assign your output to the OUT variable.
OUT = h2
# ----------------------------------------
python_script_3 = Python(IN[0]=convert_number_to_station, IN[1]=add_side_to_description, IN[2]=count_2)  # CPython3
# ---------- python_script_3.python (41 lines) ----------
# Load the Python Standard and DesignScript Libraries
import sys
import clr

# Add Assemblies for AutoCAD and Civil3D
clr.AddReference('AcMgd')
clr.AddReference('AcCoreMgd')
clr.AddReference('AcDbMgd')
clr.AddReference('AecBaseMgd')
clr.AddReference('AecPropDataMgd')
clr.AddReference('AeccDbMgd')

# Import references from AutoCAD
from Autodesk.AutoCAD.Runtime import *
from Autodesk.AutoCAD.ApplicationServices import *
from Autodesk.AutoCAD.EditorInput import *
from Autodesk.AutoCAD.DatabaseServices import *
from Autodesk.AutoCAD.Geometry import *

# Import references from Civil3D
from Autodesk.Civil.ApplicationServices import *
from Autodesk.Civil.DatabaseServices import *

# The inputs to this node will be stored as a list in the IN variables.
dataEnteringNode = IN

adoc = Application.DocumentManager.MdiActiveDocument
editor = adoc.Editor
k1=IN[0] #station
k2=IN[1] #describtion
k3=IN[2] #number
k4=[]
i=0
l=""
for i in range(k3):
    l=f"{k1[i]}_{k2[i]}"
    k4.append(l)


# Assign your output to the OUT variable.
OUT = k4
# ----------------------------------------
integer_station_2 = Python(IN[0]=round_4)  # CPython3
# ---------- integer_station_2.python (43 lines) ----------
# Load the Python Standard and DesignScript Libraries
import sys
import clr

# Add Assemblies for AutoCAD and Civil3D
clr.AddReference('AcMgd')
clr.AddReference('AcCoreMgd')
clr.AddReference('AcDbMgd')
clr.AddReference('AecBaseMgd')
clr.AddReference('AecPropDataMgd')
clr.AddReference('AeccDbMgd')

# Import references from AutoCAD
from Autodesk.AutoCAD.Runtime import *
from Autodesk.AutoCAD.ApplicationServices import *
from Autodesk.AutoCAD.EditorInput import *
from Autodesk.AutoCAD.DatabaseServices import *
from Autodesk.AutoCAD.Geometry import *

# Import references from Civil3D
from Autodesk.Civil.ApplicationServices import *
from Autodesk.Civil.DatabaseServices import *

# The inputs to this node will be stored as a list in the IN variables.
dataEnteringNode = IN

adoc = Application.DocumentManager.MdiActiveDocument
editor = adoc.Editor

k1=IN[0]
k2=[]
for i0 in k1:
    if i0 == None :
        k2.append(None)
    else:
        i=i0//10
        i1=i*10
        if i1==i0 :
            k2.append(1)
        else:
            k2.append(0)
# Assign your output to the OUT variable.
OUT = k2
# ----------------------------------------
organize_data = List.Create(item0=point_number, item1=flatten_5, item2=flatten_6, item3=flatten_7, item4=python_script_3, item5=convert_number_to_station, item6=flatten_11, item7=add_side_to_description, item8=SIDE, item9=integer_station_2)
transpose_2 = List.Transpose(lists=organize_data)

# group: siting out > EXPORT DATA TO EXCELL
code_block_29 = CodeBlock { ["Number","EASTING","NORTHING","ELEVATION","Full description","STATION","OFFSET","DESCRIPTION","Side","integer station"]; }
addItemToFront_5 = List.AddItemToFront(item=code_block_29, list=transpose_2)
code_block_30 = CodeBlock { 0; }
STOP_6 = Python(IN[0]=code_block_30, IN[1]=CODS)  # CPython3; same code as STOP_3
code_block_31 = CodeBlock { "setting out"; }
code_block_32 = CodeBlock(a=addItemToFront_5, b=STOP_6, c=code_block_31, d=code_block_17.مسار_الاكسيل_كامل, e=CODS) { a; b; c; d; e; }
exportToExcel_2 = Data.ExportToExcel(filePath=code_block_32.d, sheetName=code_block_32.c, startRow=code_block_32.b, startColumn=code_block_32.b, data=code_block_32.a, overWrite=code_block_32.e)
boolean_8 = BoolSelector(true)

design_slope = And(bool0=code_block_17.designslopecheck, bool1=code_block_17.not)
STOP_7 = Python(IN[0]=code_block_17.baseline, IN[1]=design_slope)  # CPython3; same code as STOP_3

# group: DESIGN SLOPES
code_block_33 = CodeBlock { 0; }
STOP_8 = Python(IN[0]=code_block_33, IN[1]=design_slope)  # CPython3; same code as STOP_3
code_block_34 = CodeBlock { "Station"; }
endStation = Autodesk.Civil.DynamoNodes.Baseline.EndStation(baseline=STOP_7)
code_block_35 = CodeBlock(a=endStation) { a*100; }
floor = Math.Floor(number=code_block_35)
code_block_36 = CodeBlock(a=floor) { a/100; }
startStation = Autodesk.Civil.DynamoNodes.Baseline.StartStation(baseline=STOP_7)
interval_2 = CodeBlock(a=code_block_17.interval) { a; }
code_block_37 = CodeBlock(a=startStation, b=interval_2) { a/b; }
floor_2 = Math.Floor(number=code_block_37)
code_block_38 = CodeBlock(a=floor_2, b=interval_2) { (a+1)*b; }
code_block_39 = CodeBlock(a=code_block_38, b=endStation, c=interval_2) { a..b..c; }
addItemToFront_6 = List.AddItemToFront(item=startStation, list=code_block_39)
stations = List.AddItemToEnd(item=code_block_36, list=addItemToFront_6)
convert_number_to_station_2 = Python(IN[0]=stations)  # CPython3; same code as convert_number_to_station
addItemToFront_7 = List.AddItemToFront(item=code_block_34, list=convert_number_to_station_2)
code_block_40 = CodeBlock()
# ---------- code_block_40.designscript (8 lines) ----------
"Left In Lane";
"Left In Sholder";
"Left Out Lane";
"Left Out Sholder";
"Right In Lane";
"Right In Sholder";
"Right Out Lane";
"Right Out Sholder";
# ----------------------------------------
getSlopeAtStation = Autodesk.Civil.DynamoNodes.AlignmentExtensions.GetSlopeAtStation(alignment=code_block_17.alignment, station=stations)
addItemToFront_8 = List.AddItemToFront(item=code_block_40.out0, list=getSlopeAtStation.LeftInLaneCrossSlope)
addItemToFront_9 = List.AddItemToFront(item=code_block_40.out1, list=getSlopeAtStation.LeftInShoulderCrossSlope)
addItemToFront_10 = List.AddItemToFront(item=code_block_40.out2, list=getSlopeAtStation.LeftOutLaneCrossSlope)
addItemToFront_11 = List.AddItemToFront(item=code_block_40.out3, list=getSlopeAtStation.LeftOutShoulderCrossSlope)
addItemToFront_12 = List.AddItemToFront(item=code_block_40.out4, list=getSlopeAtStation.RightInLaneCrossSlope)
addItemToFront_13 = List.AddItemToFront(item=code_block_40.out5, list=getSlopeAtStation.RightInShoulderCrossSlope)
addItemToFront_14 = List.AddItemToFront(item=code_block_40.out6, list=getSlopeAtStation.RightOutLaneCrossSlope)
addItemToFront_15 = List.AddItemToFront(item=code_block_40.out7, list=getSlopeAtStation.RightOutShoulderCrossSlope)
list_create_3 = List.Create(item0=addItemToFront_7, item1=addItemToFront_8, item2=addItemToFront_9, item3=addItemToFront_10, item4=addItemToFront_11, item5=addItemToFront_12, item6=addItemToFront_13, item7=addItemToFront_14, item8=addItemToFront_15)
transpose_3 = List.Transpose(lists=list_create_3)
اسم_الشيت = StringInput("DESIGN SLOPE")
code_block_41 = CodeBlock(a=STOP_8, b=transpose_3, c=code_block_17.مسار_الاكسيل_كامل, d=اسم_الشيت, e=design_slope) { a; b; c; d; e; }
exportToExcel_3 = Data.ExportToExcel(filePath=code_block_41.c, sheetName=code_block_41.d, startRow=code_block_41.a, startColumn=code_block_41.a, data=code_block_41.b, overWrite=code_block_41.e)

MASTER = And(bool0=code_block_17.mastercheck, bool1=code_block_17.not)
STOP_9 = Python(IN[0]=code_block_17.baseline, IN[1]=MASTER)  # CPython3; same code as STOP_3
STOP_10 = Python(IN[0]=code_block_17.document, IN[1]=MASTER)  # CPython3; same code as STOP_3

# group: master sheet
code_block_42 = CodeBlock { 0; }
STOP_11 = Python(IN[0]=code_block_42, IN[1]=MASTER)  # CPython3; same code as STOP_3
code_block_43 = CodeBlock { "Station"; }
endStation_2 = Autodesk.Civil.DynamoNodes.Baseline.EndStation(baseline=STOP_9)
code_block_44 = CodeBlock(a=endStation_2) { a*100; }
floor_3 = Math.Floor(number=code_block_44)
code_block_45 = CodeBlock(a=floor_3) { a/100; }
startStation_2 = Autodesk.Civil.DynamoNodes.Baseline.StartStation(baseline=STOP_9)
interval_3 = CodeBlock(a=code_block_17.interval) { a; }
code_block_46 = CodeBlock(a=startStation_2, b=interval_3) { a/b; }
floor_4 = Math.Floor(number=code_block_46)
code_block_47 = CodeBlock(a=floor_4, b=interval_3) { (a+1)*b; }
code_block_48 = CodeBlock(a=code_block_47, b=endStation_2, c=interval_3) { a..b..c; }
addItemToFront_16 = List.AddItemToFront(item=startStation_2, list=code_block_48)
stations_2 = List.AddItemToEnd(item=code_block_45, list=addItemToFront_16)
convert_number_to_station_3 = Python(IN[0]=stations_2)  # CPython3; same code as convert_number_to_station
addItemToFront_17 = List.AddItemToFront(item=code_block_43, list=convert_number_to_station_3)
code_block_49 = CodeBlock { "NGL Level"; "Design Level"; }
pointByStationOffsetElevation = Autodesk.Civil.DynamoNodes.Baseline.PointByStationOffsetElevation(baseline=STOP_9, station=stations_2)
Z_2 = Point.Z(point=pointByStationOffsetElevation)
منسوب_التصميم = List.AddItemToFront(item=code_block_49.out1, list=Z_2)
code_block_50 = CodeBlock { "Cancel"; "تصميم م عمر الخولي"; }
string_13 = StringInput("اختر سطح الارض الطبيعية")
surfaces = Surfaces(document=STOP_10)
code_block_51 = CodeBlock(a=surfaces) { a.Name; }
code_block_52 = CodeBlock { 0; }
dropdown_data_3 = Custom[DropDown Data](InputName=string_13, Keys=code_block_51, Values=code_block_51, DefaultValueIndex=code_block_52)
flatten_12 = List.Flatten(list=dropdown_data_3)
code_block_53 = CodeBlock(a=flatten_12, b=MASTER) { a; b; }
multipleinputform_3 = Custom[MultipleInputForm ++](Description_optional=code_block_50.out1, Inputs=flatten_12, Toggle=code_block_53.b, CancelButtonText_optional=code_block_50.out0)
code_block_54 = CodeBlock(a=multipleinputform_3.User_Inputs) { a; }
سطح_الارض_الطبيعية = Autodesk.Civil.DynamoNodes.Selection.SurfaceByName(name=code_block_54, document=STOP_10)
X_2 = Point.X(point=pointByStationOffsetElevation)
list_create_4 = List.Create(item0=X_2)
اسم_الشيت_2 = StringInput("master sheet")
watch = Watch(multipleinputform_3.User_Inputs)

Y_2 = Point.Y(point=pointByStationOffsetElevation)

# group (continued): master sheet
list_create_5 = List.Create(item0=Y_2)
elevationByXY = Autodesk.Civil.DynamoNodes.Surface.ElevationByXY(surface=سطح_الارض_الطبيعية, x=list_create_4, y=list_create_5)
flatten_13 = List.Flatten(list=elevationByXY)
منسوب_الارض_الطبيعية = List.AddItemToFront(item=code_block_49.out0, list=flatten_13)
list_create_6 = List.Create(item0=addItemToFront_17, item1=منسوب_التصميم, item2=منسوب_الارض_الطبيعية)
transpose_4 = List.Transpose(lists=list_create_6)
code_block_55 = CodeBlock(a=STOP_11, b=transpose_4, c=code_block_17.مسار_الاكسيل_كامل, d=اسم_الشيت_2, e=MASTER) { a; b; c; d; e; }
exportToExcel_4 = Data.ExportToExcel(filePath=code_block_55.c, sheetName=code_block_55.d, startRow=code_block_55.a, startColumn=code_block_55.a, data=code_block_55.b, overWrite=code_block_55.e)

slope_width = And(bool0=code_block_17.slopewidthcheck, bool1=code_block_17.not)
STOP_12 = Python(IN[0]=code_block_17.baseline, IN[1]=slope_width)  # CPython3; same code as STOP_3

# group: slope and width
code_block_56 = CodeBlock { 0; }
STOP_13 = Python(IN[0]=code_block_56, IN[1]=slope_width)  # CPython3; same code as STOP_3
code_block_57 = CodeBlock { "Station"; "Slope"; "Width"; "IntegarStation"; }
code_block_58 = CodeBlock(a=STOP_12) { a; }
string_14 = StringInput("كود بداية الحارة")
corridorFeatureLines_2 = Autodesk.Civil.DynamoNodes.Baseline.CorridorFeatureLines(baseline=code_block_58)
code_2 = Autodesk.Civil.DynamoNodes.CorridorFeatureLine.Code(corridorFeatureLine=corridorFeatureLines_2)
code_block_59 = CodeBlock { 0; }
dropdown_data_4 = Custom[DropDown Data](InputName=string_14, Keys=code_2, Values=code_2, DefaultValueIndex=code_block_59)
string_15 = StringInput("كود نهاية الحارة")
code_block_60 = CodeBlock { 1; }
dropdown_data_5 = Custom[DropDown Data](InputName=string_15, Keys=code_2, Values=code_2, DefaultValueIndex=code_block_60)
list_create_7 = List.Create(item0=dropdown_data_4, item1=dropdown_data_5)
flatten_14 = List.Flatten(list=list_create_7)
code_block_61 = CodeBlock { "Cancel"; "تصميم م عمر الخولي"; }
code_block_62 = CodeBlock(A=flatten_14, B=slope_width, c=code_block_61.out1, d=flatten_14, e=code_block_61.out0) { A; B; c; d; e; }
multipleinputform_4 = Custom[MultipleInputForm ++](Description_optional=code_block_62.c, Inputs=code_block_62.d, Toggle=code_block_62.B, CancelButtonText_optional=code_block_62.e)
code_block_63 = CodeBlock(a=multipleinputform_4.User_Inputs) { a[0]; a[1]; }
corridorFeatureLinesByCode = Autodesk.Civil.DynamoNodes.Baseline.CorridorFeatureLinesByCode(baseline=code_block_58, code=code_block_63.out0)
points_2 = Autodesk.Civil.DynamoNodes.CorridorFeatureLine.Points(corridorFeatureLine=corridorFeatureLinesByCode)
corridorFeatureLinesByCode_2 = Autodesk.Civil.DynamoNodes.Baseline.CorridorFeatureLinesByCode(baseline=code_block_58, code=code_block_63.out1)
points_3 = Autodesk.Civil.DynamoNodes.CorridorFeatureLine.Points(corridorFeatureLine=corridorFeatureLinesByCode_2)
code_block_64 = CodeBlock { 2; }
code_block_65 = CodeBlock { 5; }
code_block_66 = CodeBlock { " to "; }
concat_6 = String.Concat(string0=code_block_63.out0, string1=code_block_66, string2=code_block_63.out1)

# group: slope and width > get station for the points
flatten_15 = List.Flatten(list=points_2)
list_create_8 = List.Create(item0=flatten_15)
stationOffsetByPoint_2 = Autodesk.Civil.DynamoNodes.Baseline.StationOffsetByPoint(baseline=code_block_58, point=list_create_8)

# group (continued): slope and width
flatten_16 = List.Flatten(list=stationOffsetByPoint_2.Station)
flatten_17 = List.Flatten(list=stationOffsetByPoint_2.Offset)
flatten_18 = List.Flatten(list=stationOffsetByPoint_2.Elevation)
flatten_19 = List.Flatten(list=stationOffsetByPoint_2.Elevation)
width = List.AddItemToFront(item=code_block_63.out0, list=flatten_19)

# group: slope and width > get station for the points
flatten_20 = List.Flatten(list=points_3)
list_create_9 = List.Create(item0=flatten_20)
stationOffsetByPoint_3 = Autodesk.Civil.DynamoNodes.Baseline.StationOffsetByPoint(baseline=code_block_58, point=list_create_9)

# group (continued): slope and width
flatten_21 = List.Flatten(list=stationOffsetByPoint_3.Offset)
flatten_22 = List.Flatten(list=stationOffsetByPoint_3.Elevation)
slope_and_width = Python(IN[0]=flatten_16, IN[1]=flatten_17, IN[2]=flatten_21, IN[3]=flatten_18, IN[4]=flatten_22)  # CPython3
# ---------- slope_and_width.python (52 lines) ----------
# Load the Python Standard and DesignScript Libraries
import sys
import clr

# Add Assemblies for AutoCAD and Civil3D
clr.AddReference('AcMgd')
clr.AddReference('AcCoreMgd')
clr.AddReference('AcDbMgd')
clr.AddReference('AecBaseMgd')
clr.AddReference('AecPropDataMgd')
clr.AddReference('AeccDbMgd')

# Import references from AutoCAD
from Autodesk.AutoCAD.Runtime import *
from Autodesk.AutoCAD.ApplicationServices import *
from Autodesk.AutoCAD.EditorInput import *
from Autodesk.AutoCAD.DatabaseServices import *
from Autodesk.AutoCAD.Geometry import *

# Import references from Civil3D
from Autodesk.Civil.ApplicationServices import *
from Autodesk.Civil.DatabaseServices import *

# The inputs to this node will be stored as a list in the IN variables.
dataEnteringNode = IN

adoc = Application.DocumentManager.MdiActiveDocument
editor = adoc.Editor

station=IN[0]
offset1=IN[1]
offset2=IN[2]
elevation1=IN[3]
elevation2=IN[4]


slopelist=[]
widthlist=[]

offsdef=0
elevdef=0
i=0
for i in range(len(station)):
    offsdef = offset2[i] - offset1[i]
    elevdef = elevation2[i] - elevation1[i]
    widthlist.append(abs(offsdef))
    slopelist.append(elevdef/max(abs(offsdef),0.000000001))
    

# Assign your output to the OUT variable.

OUT=[station,slopelist,widthlist]
# ----------------------------------------
code_block_67 = CodeBlock(a=slope_and_width) { a[0]; a[1]; a[2]; }
round_5 = Math.Round(number=code_block_67.out0, digits=code_block_64)
convert_number_to_station_4 = Python(IN[0]=round_5)  # CPython3; same code as convert_number_to_station
station_2 = List.AddItemToFront(item=code_block_57.out0, list=convert_number_to_station_4)
slope = List.AddItemToFront(item=code_block_57.out1, list=code_block_67.out1)
width_2 = List.AddItemToFront(item=code_block_57.out2, list=code_block_67.out2)
round_6 = Math.Round(number=code_block_67.out0, digits=code_block_65)
integer_station_3 = Python(IN[0]=round_6)  # CPython3; same code as integer_station_2
integar_station = List.AddItemToFront(item=code_block_57.out3, list=integer_station_3)
flatten_23 = List.Flatten(list=stationOffsetByPoint_3.Elevation)
width_3 = List.AddItemToFront(item=code_block_63.out1, list=flatten_23)
list_create_10 = List.Create(item0=station_2, item1=slope, item2=width_2, item3=integar_station, item4=width, item5=width_3)
transpose_5 = List.Transpose(lists=list_create_10)
code_block_68 = CodeBlock(a=STOP_13, b=transpose_5, c=code_block_17.مسار_الاكسيل_كامل, d=concat_6, e=slope_width) { a; b; c; d; e; }
exportToExcel_5 = Data.ExportToExcel(filePath=code_block_68.c, sheetName=code_block_68.d, startRow=code_block_68.a, startColumn=code_block_68.a, data=code_block_68.b, overWrite=code_block_68.e)

corridorFeaturelines_2 = Civil3D.Geometry.Corridor.CorridorFeaturelines(baseline=code_block_17.baseline)
code_block_69 = CodeBlock(a=corridorFeaturelines_2) { a[0]; }
python_script_4 = Python(IN[0]=code_block_69, IN[1]=code_block_17.alignment)  # CPython3
# ---------- python_script_4.python (57 lines) ----------
# Load the Python Standard and DesignScript Libraries
import sys
import clr

# Add Assemblies for AutoCAD and Civil3D
clr.AddReference('AcMgd')
clr.AddReference('AcCoreMgd')
clr.AddReference('AcDbMgd')
clr.AddReference('AecBaseMgd')
clr.AddReference('AecPropDataMgd')
clr.AddReference('AeccDbMgd')

# Import references from AutoCAD
from Autodesk.AutoCAD.Runtime import *
from Autodesk.AutoCAD.ApplicationServices import *
from Autodesk.AutoCAD.EditorInput import *
from Autodesk.AutoCAD.DatabaseServices import *
from Autodesk.AutoCAD.Geometry import *

# Import references from Civil3D
from Autodesk.Civil.ApplicationServices import *
from Autodesk.Civil.DatabaseServices import *

# The inputs to this node will be stored as a list in the IN variables.
dataEnteringNode = IN

adoc = Application.DocumentManager.MdiActiveDocument
editor = adoc.Editor
alignment = IN[1]
feature = IN[0]
list=[]

k=feature
#o=list.__dir__()
#o=k.__dir__()
#o=k.StationsAndOffsets.__dir__()
#o=k.StartPoint().__dir__()
l=k.StartPoint()

#o=l.__dir__()
#o=l.distanceto()
#o=k

#with adoc.LockDocument():
#    with adoc.Database as db:
#
#        with db.TransactionManager.StartTransaction() as t:
#            # Place your code below
#            # 
#            #
#
#            # Commit before end transaction
#            #t.Commit()
#            pass

# Assign your output to the OUT variable.
OUT = l
# ----------------------------------------
stationsAndOffsets_2 = Civil3D.Geometry.CorridorFeatureLine.StationsAndOffsets()  # unwired: corridorFeatureLine
python_script_5 = Python(IN[0]=code_block_17.baseline)  # CPython3
# ---------- python_script_5.python (1 lines) ----------
OUT=IN[0]
# ----------------------------------------
code_block_70 = CodeBlock {  }
